vi "Function.gvi"   [LabVIEW Communications System Design Software 2.0.1]
panel controls:
  "stop": bool
panel indicators:
  "DSB-SC time": waveform<f64>
  "demodulating signa timel": waveform<f64>
  "wave time": waveform<f64>
  "carrie timer": waveform<f64>
  "baseband spectra": T1
  "carrier spectra": T1
  "DSB-SC spectra": T1
  "demodulation spectra": T1
types:
  T1 = cluster{"f0": f64, "df": f64, "magnitude": f64[]}
uses:
  NI::Analysis::Generation::Sine Waveform.gvi
  NI::Analysis::Filtering::Butterworth Lowpass Filter (Waveform).gvi
  NI::Analysis::Measurement::Power Spectral Density for 1 Chan.gvi
diagram:
  while {
    call "Sine Waveform.gvi"(amplitude=6, frequency=10000, sample rate=100000) -> (sine wave=w1)
    call "Sine Waveform.gvi"(frequency=1000, sample rate=100000) -> (sine wave=w2)
    Waveform Multiply(w2, w1) -> w3
    Waveform Multiply(w3, w1) -> w4
    call "Butterworth Lowpass Filter (Waveform).gvi"(signal=w4, cutoff frequency=1000, order=7) -> (filtered signal=w5)
    call "Power Spectral Density for 1 Chan.gvi"(signal=w5) -> (power spectral density=w6)
    $"demodulation spectra" <- w6
    call "Power Spectral Density for 1 Chan.gvi"(signal=w2) -> (power spectral density=w7)
    $"baseband spectra" <- w7
    $"wave time" <- w2
    call "Power Spectral Density for 1 Chan.gvi"(signal=w3) -> (power spectral density=w8)
    $"DSB-SC spectra" <- w8
    $"DSB-SC time" <- w3
    $"demodulating signa timel" <- w5
    call "Power Spectral Density for 1 Chan.gvi"(signal=w1) -> (power spectral density=w9)
    $"carrier spectra" <- w9
    $"carrie timer" <- w1
    stop if $stop
  }
