vi "Function.gvi"   [LabVIEW Communications System Design Software 2.0.1]
panel controls:
  "stop": bool
panel indicators:
  "demodulated time": waveform<f64>
  "carrier wave": waveform<f64>
  "basseband wave": waveform<f64>
  "demodualted -frequancy": T1
  "modulated frequancyl": T1
types:
  T1 = cluster{"f0": f64, "df": f64, "magnitude": f64[]}
uses:
  NI::Analysis::Generation::Sine Waveform.gvi
  NI::Analysis::Filtering::Butterworth Lowpass Filter (Waveform).gvi
  NI::Analysis::Measurement::Power Spectral Density for 1 Chan.gvi
diagram:
  while {
    call "Sine Waveform.gvi"(frequency=1000, sample rate=50000, samples=500) -> (sine wave=w1)
    $"basseband wave" <- w1
    call "Sine Waveform.gvi"(amplitude=2, frequency=10000, sample rate=50000, samples=500) -> (sine wave=w2)
    Waveform Multiply(w1, w2) -> w3
    Waveform Add(w3, w2) -> w4
    Waveform Multiply(w4, w2) -> w5
    call "Butterworth Lowpass Filter (Waveform).gvi"(signal=w5, cutoff frequency=1500, order=4) -> (filtered signal=w6)
    call "Power Spectral Density for 1 Chan.gvi"(signal=w6) -> (power spectral density=w7)
    $"demodualted -frequancy" <- w7
    $"demodulated time" <- w6
    $"carrier wave" <- w2
    call "Power Spectral Density for 1 Chan.gvi"(signal=w4) -> (power spectral density=w8)
    $"modulated frequancyl" <- w8
    stop if $stop
  }
