vi "Function.gvi"   [LabVIEW Communications System Design Software 2.0.1]
panel indicators:
  "baseband signal": T1
  "carrier signal": T1
  "modulated filtered": waveform<f64>
  "demodulated filtered": waveform<f64>
  "demodulated signal": T1
  "USB spectra": T1
types:
  T1 = cluster{"f0": f64, "df": f64, "magnitude": f64[]}
uses:
  NI::Analysis::Generation::Sine Waveform.gvi
  NI::Analysis::Measurement::Power Spectral Density for 1 Chan.gvi
  NI::Analysis::Filtering::Butterworth Bandpass Filter (Waveform).gvi
  NI::Analysis::Filtering::Butterworth Lowpass Filter (Waveform).gvi
diagram:
  while {
    call "Sine Waveform.gvi"(amplitude=5, frequency=1000, sample rate=50000, samples=132) -> (sine wave=w1)
    call "Power Spectral Density for 1 Chan.gvi"(signal=w1) -> (power spectral density=w2)
    $"baseband signal" <- w2
    call "Sine Waveform.gvi"(frequency=10000, sample rate=50000, samples=132) -> (sine wave=w3)
    Waveform Multiply(w1, w3) -> w4
    call "Butterworth Bandpass Filter (Waveform).gvi"(signal=w4, high cutoff frequency=12000, low cutoff frequency=10000, order=7) -> (filtered signal=w5)
    Waveform Multiply(w3, w5) -> w6
    call "Butterworth Lowpass Filter (Waveform).gvi"(signal=w6, cutoff frequency=2000, order=4) -> (filtered signal=w7)
    $"demodulated filtered" <- w7
    call "Power Spectral Density for 1 Chan.gvi"(signal=w7) -> (power spectral density=w8)
    $"demodulated signal" <- w8
    $"modulated filtered" <- w5
    call "Power Spectral Density for 1 Chan.gvi"(signal=w3) -> (power spectral density=w9)
    $"carrier signal" <- w9
    call "Power Spectral Density for 1 Chan.gvi"(signal=w5) -> (power spectral density=w10)
    $"USB spectra" <- w10
    stop if w11
  }
