vi "Function.gvi"   [LabVIEW Communications System Design Software 2.0.1]
panel controls:
  "stop": bool
panel indicators:
  "modualted signal": T1
  "baseband signal": T1
  "carrier siganl": T1
  "modulated filtered signal": waveform<f64>
  "filtered modulated signal": T1
  "demodulated filtered signal": waveform<f64>
  "demodulated signal": T1
types:
  T1 = cluster{"f0": f64, "df": f64, "magnitude": f64[]}
uses:
  NI::Analysis::Generation::Sine Waveform.gvi
  NI::Analysis::Measurement::Power Spectral Density for 1 Chan.gvi
  NI::Analysis::Filtering::Butterworth Bandpass Filter (Waveform).gvi
  NI::Analysis::Filtering::Butterworth Lowpass Filter (Waveform).gvi
diagram:
  while {
    call "Sine Waveform.gvi"(amplitude=5, frequency=1000, sample rate=50000, samples=132) -> (sine wave=w1)
    call "Power Spectral Density for 1 Chan.gvi"(signal=w1) -> (power spectral density=w2)
    $"baseband signal" <- w2
    call "Sine Waveform.gvi"(frequency=10000, sample rate=50000, samples=132) -> (sine wave=w3)
    Waveform Multiply(w1, w3) -> w4
    Waveform Add(w4, w3) -> w5
    call "Power Spectral Density for 1 Chan.gvi"(signal=w5) -> (power spectral density=w6)
    $"modualted signal" <- w6
    call "Butterworth Bandpass Filter (Waveform).gvi"(signal=w5, high cutoff frequency=10500, low cutoff frequency=8500, order=7) -> (filtered signal=w7)
    Waveform Multiply(w7, w3) -> w8
    call "Butterworth Lowpass Filter (Waveform).gvi"(signal=w8, cutoff frequency=1500, order=7) -> (filtered signal=w9)
    $"demodulated filtered signal" <- w9
    call "Power Spectral Density for 1 Chan.gvi"(signal=w9) -> (power spectral density=w10)
    $"demodulated signal" <- w10
    call "Power Spectral Density for 1 Chan.gvi"(signal=w3) -> (power spectral density=w11)
    $"carrier siganl" <- w11
    $"modulated filtered signal" <- w7
    call "Power Spectral Density for 1 Chan.gvi"(signal=w7) -> (power spectral density=w12)
    $"filtered modulated signal" <- w12
    stop if $stop
  }
